# Grasshopper definition Topoceros_Sample_SpaceSyntax.ghx (Grasshopper 1.0.7)
# plug-ins: Topoceros

# ---- group: INPUT
zones = Brep([<brep referenced from the Rhino model> x8])

# ----
brep_join = BrepJoin(Breps=zones)  # -> Breps, Closed
deconstruct_brep = DeconstructBrep(Brep=brep_join.Breps)  # -> Vertices, Edges, flatten(Faces)
adjacentfaces = AdjacentFaces(SubElement=deconstruct_brep.Faces)
list_length = ListLength(List=adjacentfaces)  # -> flatten(Length)

# ---- group: OUTPUT
adjacency = Number(list_length)

# ---- group: COLOR SPACES BASED ON ADJACENCY
adjacency_2 = Number(adjacency)
zones_2 = Brep(zones)
sort_list = SortList(Keys=adjacency_2, ValuesA=zones_2)  # -> Keys, ValuesA
list_item = ListItem(List=reverse(sort_list.Keys), Index=0, Wrap=True)  # -> Item1, Item
construct_domain = ConstructDomain(DomainStart=list_item.Item1, DomainEnd=list_item.Item)
remap_numbers = RemapNumbers(Value=sort_list.Keys, Source=construct_domain, Target=Domain(0, 1))  # -> Mapped, Clipped
area = Area(Geometry=sort_list.ValuesA)  # -> Area, Centroid
gradient = Gradient(
    LowerLimit=0,
    UpperLimit=1,
    Parameter=remap_numbers.Mapped,
    stops=[0: RGB(0, 128, 0), 0.5: RGB(255, 255, 0), 1: RGB(255, 0, 0)])
number_slider = Slider(75, range=0..1000)
colour_swatch = ColourSwatch(SwatchColor=RGB(0, 0, 0))

# ---- group: COLOR SPACES BASED ON ADJACENCY / PREVIEW
text_tag_3d = TextTag3D(Location=area.Centroid, Text=sort_list.Keys, Size=number_slider, Colour=colour_swatch, Justification=5)
custom_preview = CustomPreview(Geometry=sort_list.ValuesA, Material=gradient)
